# Dynamo graph 35- Create beams based on arch walls in linked model with spacing.dyn (Dynamo 2.19.3.6394)

select_model_element = DSModelElementSelection()  # 1 picked in the model
structural_framing_types = StructuralFramingTypes("250 x 600")
levels = Levels("Level 2")
code_block = CodeBlock { 1000; }
python_script = Python(IN[0]=select_model_element, IN[1]=structural_framing_types, IN[2]=levels, IN[3]=code_block)  # CPython3
# ---------- python_script.python (581 lines) ----------
import clr


# =========================================================
# REVIT API
# =========================================================

clr.AddReference("RevitAPI")

from Autodesk.Revit.DB import (
    FilteredElementCollector,
    BuiltInCategory,
    RevitLinkInstance,
    LocationCurve,
    XYZ,
    Line,
    Transaction,
    BuiltInParameter,
    ElementId,
    Transform
)

from Autodesk.Revit.DB.Structure import StructuralType


# =========================================================
# REVIT SERVICES
# =========================================================

clr.AddReference("RevitServices")

from RevitServices.Persistence import DocumentManager


# =========================================================
# HOST DOCUMENT
# =========================================================

doc = DocumentManager.Instance.CurrentDBDocument


# =========================================================
# DYNAMO INPUTS
# =========================================================

link_instance = UnwrapElement(IN[0])

beam_type = UnwrapElement(IN[1])

host_level = UnwrapElement(IN[2])

spacing_mm = IN[3]


# =========================================================
# UNIT CONVERSION
# =========================================================

MM_TO_FT = 1.0 / 304.8

spacing_ft = spacing_mm * MM_TO_FT


# =========================================================
# CHECK SPACING
# =========================================================

if spacing_ft <= 0:

    OUT = "Spacing must be greater than zero."


else:

    # =====================================================
    # CHECK LINK
    # =====================================================

    if link_instance is None:

        OUT = "IN[0] is empty."


    elif not isinstance(
        link_instance,
        RevitLinkInstance
    ):

        OUT = [
            "IN[0] is not a RevitLinkInstance.",
            link_instance.GetType().FullName
        ]


    else:

        # =================================================
        # GET LINKED ARCHITECTURAL DOCUMENT
        # =================================================

        linked_doc = link_instance.GetLinkDocument()


        if linked_doc is None:

            OUT = [
                "The Revit Link was found.",
                "But the linked document is not available."
            ]


        else:

            # =============================================
            # GET LINK TRANSFORM
            # =============================================

            link_transform = link_instance.GetTransform()


            # =============================================
            # COLLECT ARCHITECTURAL WALLS
            # =============================================

            walls = (
                FilteredElementCollector(linked_doc)
                .OfCategory(BuiltInCategory.OST_Walls)
                .WhereElementIsNotElementType()
                .ToElements()
            )


            # =============================================
            # RESULT LISTS
            # =============================================

            created_beams = []

            processed_walls = []

            skipped_walls = []

            errors = []

            wall_information = []


            # =============================================
            # START TRANSACTION
            # =============================================

            transaction = Transaction(
                doc,
                "Create Structural Framing From Wall Heights"
            )

            transaction.Start()


            # =============================================
            # ACTIVATE BEAM TYPE
            # =============================================

            if not beam_type.IsActive:

                beam_type.Activate()

                doc.Regenerate()


            # =============================================
            # LOOP THROUGH ARCHITECTURAL WALLS
            # =============================================

            for wall in walls:

                try:

                    # =====================================
                    # GET WALL LOCATION
                    # =====================================

                    location = wall.Location


                    if not isinstance(
                        location,
                        LocationCurve
                    ):

                        skipped_walls.append(
                            wall.Id.IntegerValue
                        )

                        continue


                    # =====================================
                    # GET WALL CENTERLINE
                    # =====================================

                    wall_curve = location.Curve


                    if wall_curve is None:

                        skipped_walls.append(
                            wall.Id.IntegerValue
                        )

                        continue


                    # =====================================
                    # GET BASE LEVEL PARAMETER
                    # =====================================

                    base_level_parameter = wall.get_Parameter(
                        BuiltInParameter.WALL_BASE_CONSTRAINT
                    )


                    if base_level_parameter is None:

                        skipped_walls.append(
                            wall.Id.IntegerValue
                        )

                        continue


                    # =====================================
                    # GET BASE LEVEL ID
                    # =====================================

                    base_level_id = (
                        base_level_parameter.AsElementId()
                    )


                    # =====================================
                    # GET BASE LEVEL
                    # =====================================

                    base_level = linked_doc.GetElement(
                        base_level_id
                    )


                    if base_level is None:

                        skipped_walls.append(
                            wall.Id.IntegerValue
                        )

                        continue


                    # =====================================
                    # GET BASE OFFSET
                    # =====================================

                    base_offset_parameter = wall.get_Parameter(
                        BuiltInParameter.WALL_BASE_OFFSET
                    )


                    if base_offset_parameter is not None:

                        base_offset = (
                            base_offset_parameter.AsDouble()
                        )

                    else:

                        base_offset = 0.0


                    # =====================================
                    # CALCULATE ACTUAL BASE ELEVATION
                    # =====================================

                    base_z = (
                        base_level.Elevation
                        + base_offset
                    )


                    # =====================================
                    # GET TOP CONSTRAINT
                    # =====================================

                    top_level_parameter = wall.get_Parameter(
                        BuiltInParameter.WALL_HEIGHT_TYPE
                    )


                    top_z = None

                    top_level = None


                    if top_level_parameter is not None:

                        top_level_id = (
                            top_level_parameter.AsElementId()
                        )


                        # =================================
                        # WALL HAS TOP CONSTRAINT
                        # =================================

                        if top_level_id != ElementId.InvalidElementId:

                            top_level = linked_doc.GetElement(
                                top_level_id
                            )


                            if top_level is not None:

                                # =============================
                                # GET TOP OFFSET
                                # =============================

                                top_offset_parameter = wall.get_Parameter(
                                    BuiltInParameter.WALL_TOP_OFFSET
                                )


                                if top_offset_parameter is not None:

                                    top_offset = (
                                        top_offset_parameter.AsDouble()
                                    )

                                else:

                                    top_offset = 0.0


                                # =============================
                                # CALCULATE TOP ELEVATION
                                # =============================

                                top_z = (
                                    top_level.Elevation
                                    + top_offset
                                )


                    # =====================================
                    # WALL HAS NO TOP CONSTRAINT
                    # =====================================

                    if top_z is None:

                        height_parameter = wall.get_Parameter(
                            BuiltInParameter.WALL_USER_HEIGHT_PARAM
                        )


                        if height_parameter is None:

                            skipped_walls.append(
                                wall.Id.IntegerValue
                            )

                            continue


                        wall_height = (
                            height_parameter.AsDouble()
                        )


                        top_z = (
                            base_z
                            + wall_height
                        )


                    # =====================================
                    # CHECK WALL HEIGHT
                    # =====================================

                    wall_height = top_z - base_z


                    if wall_height <= 0:

                        skipped_walls.append(
                            wall.Id.IntegerValue
                        )

                        continue


                    # =====================================
                    # TRANSFORM WALL CURVE
                    # LINK → HOST
                    # =====================================

                    host_curve = (
                        wall_curve.CreateTransformed(
                            link_transform
                        )
                    )


                    # =====================================
                    # GET CURRENT CURVE Z
                    # =====================================

                    curve_start = host_curve.GetEndPoint(0)

                    current_curve_z = curve_start.Z


                    # =====================================
                    # CALCULATE VERTICAL TRANSLATION
                    # =====================================

                    z_translation = (
                        base_z - current_curve_z
                    )


                    translation = Transform.CreateTranslation(
                        XYZ(
                            0.0,
                            0.0,
                            z_translation
                        )
                    )


                    # =====================================
                    # MOVE CURVE TO WALL BASE ELEVATION
                    # =====================================

                    base_curve = (
                        host_curve.CreateTransformed(
                            translation
                        )
                    )


                    # =====================================
                    # NUMBER OF SPACES
                    # =====================================

                    number_of_spaces = int(
                        wall_height / spacing_ft
                    )


                    # =====================================
                    # CREATE BEAMS
                    # =====================================

                    wall_beam_count = 0


                    for i in range(
                        number_of_spaces + 1
                    ):

                        beam_z_offset = (
                            i * spacing_ft
                        )


                        # =================================
                        # STOP IF ABOVE WALL TOP
                        # =================================

                        if (
                            base_z
                            + beam_z_offset
                            > top_z + 0.001
                        ):

                            break


                        # =================================
                        # TRANSLATE BASE CURVE
                        # =================================

                        beam_translation = (
                            Transform.CreateTranslation(
                                XYZ(
                                    0.0,
                                    0.0,
                                    beam_z_offset
                                )
                            )
                        )


                        beam_curve = (
                            base_curve.CreateTransformed(
                                beam_translation
                            )
                        )


                        # =================================
                        # CREATE STRUCTURAL BEAM
                        # =================================

                        beam = doc.Create.NewFamilyInstance(
                            beam_curve,
                            beam_type,
                            host_level,
                            StructuralType.Beam
                        )


                        # =================================
                        # STORE BEAM
                        # =================================

                        created_beams.append(
                            beam
                        )


                        wall_beam_count += 1


                    # =====================================
                    # STORE WALL INFORMATION
                    # =====================================

                    wall_information.append(
                        [
                            wall.Id.IntegerValue,
                            base_z,
                            top_z,
                            wall_height,
                            wall_beam_count
                        ]
                    )


                    processed_walls.append(
                        wall.Id.IntegerValue
                    )


                except Exception as e:

                    errors.append(
                        "Wall ID {} : {}".format(
                            wall.Id.IntegerValue,
                            str(e)
                        )
                    )


            # =============================================
            # COMMIT TRANSACTION
            # =============================================

            transaction.Commit()


            # =============================================
            # OUTPUT
            # =============================================

            OUT = [
                created_beams,
                processed_walls,
                skipped_walls,
                errors,
                wall_information
            ]
# ----------------------------------------
